# Grasshopper definition Dogbone.gh (Grasshopper 0.9.76)
# plug-ins: LunchBox

# ----
# Estimated Diamter of Router Bit
# offset to allow bit clearance
bit_diameter = ValueList({".125": .0625, ".25": .125, ".375": .1875, "6": 3}, selected="6")
tolerance_offset = Slider(0.01, range=0..0.1)

# ----
# Closed Curves for
# Dogbone Inside Corners
outside_curves = Curve([<curve referenced from the Rhino model> x8])
holes = Curve(<curve referenced from the Rhino model>)
output_layer_color = ColourSwatch(SwatchColor=RGB(0, 0, 255))
output_layer_color_2 = ColourSwatch(SwatchColor=RGB(0, 255, 255))

# ----
# Bake Geometry
# created by Noah Z Brock
# noahzbrock.com
bake = Button()

addition = Addition(A=bit_diameter, B=tolerance_offset)
notch_position = Slider(0.5, range=0..1)

explode = Explode(Curve=outside_curves, Recursive=True)  # -> Segments, Vertices
cir = Circle(Plane=explode.Vertices, Radius=addition)
trim = TrimWithRegion(Curve=cir, Region=graft(outside_curves))  # -> Inside, Outside
len = Length(Curve=trim.Inside)
pi = Pi(Factor=addition)
ma = MassAddition(Input=len)  # -> Result, PartialResult
larger = LargerThan(FirstNumber=ma.Result, SecondNumber=pi)  # -> LargerThan, OrEqualTo
cull = CullPattern(List=trim.Outside, CullPattern=larger.LargerThan)

eval = EvaluateCurve(Curve=reparameterize(cull), Parameter=notch_position)  # -> Point, Tangent, Angle

circle = CircleCNR(Center=eval.Point, Normal=Vector(0, 0, 1), Radius=addition)
rdiff = RegionDifference(GroupA=outside_curves, GroupB=flatten(circle))

explode_2 = Explode(Curve=holes, Recursive=True)  # -> Segments, Vertices
cir_2 = Circle(Plane=explode_2.Vertices, Radius=addition)
trim_2 = TrimWithRegion(Curve=cir_2, Region=graft(holes))  # -> Inside, Outside
len_2 = Length(Curve=trim_2.Outside)
pi_2 = Pi(Factor=addition)
ma_2 = MassAddition(Input=len_2)  # -> Result, PartialResult
larger_2 = LargerThan(FirstNumber=ma_2.Result, SecondNumber=pi_2)  # -> LargerThan, OrEqualTo
cull_2 = CullPattern(List=trim_2.Inside, CullPattern=larger_2.LargerThan)

eval_2 = EvaluateCurve(Curve=reparameterize(cull_2), Parameter=notch_position)  # -> Point, Tangent, Angle

circle_2 = CircleCNR(Center=eval_2.Point, Normal=Vector(0, 0, 1), Radius=addition)
runion = RegionUnion(Curves=flatten([circle_2, holes]))

bake_2 = ObjectBake(
    BakeToggle=bake,
    GeometryObjects=rdiff,
    Layer="Outside Curves",
    ObjectName="Out",
    ObjectColor=output_layer_color,
    LayerColor=output_layer_color)
bake_3 = ObjectBake(
    BakeToggle=bake,
    GeometryObjects=runion,
    Layer="Inside Curves",
    ObjectName="In",
    ObjectColor=output_layer_color_2,
    LayerColor=output_layer_color_2)
preview = CustomPreview(Geometry=rdiff, Shader=output_layer_color)
preview_2 = CustomPreview(Geometry=runion, Shader=output_layer_color_2)
