# Grasshopper definition easel.gh (Grasshopper 0.9.76)
# plug-ins: Kangaroo Components

height_of_deploy = Slider(526, range=0..1000)
angle_break = Slider(292, range=0..1000)
width = Slider(56, range=0..100)
painting_stand_x = Slider(534, range=0..1000)
painting_stand_y = Slider(162, range=0..1000)
painting_stand_y_2 = Slider(85, range=0..1000)
painting_stand_x_2 = Slider(274, range=0..1000)
stand_support = Slider(1061, range=0..2000)
easel_tip = Slider(1355, range=0..2000)
thickness_of_middle_post = Slider(0.5, range=0..1)
material_thickness = Slider(15.2, range=0..100)
number_slider = Slider(14, range=0..100)
crv = Curve(<curve referenced from the Rhino model>)
area = Area(Geometry=crv)  # -> Area, Centroid
scale = Scale(Geometry=crv, Center=area.Centroid, Factor=Slider(1.2, range=0..10))  # -> Geometry, Transform
area_2 = Area(Geometry=scale.Geometry)  # -> Area, Centroid
explode = Explode(Curve=scale.Geometry, Recursive=True)  # -> Segments, Vertices
area_3 = Area(Geometry=scale.Geometry)  # -> Area, Centroid
item = ListItem(List=explode.Segments, Index=0, Wrap=True)  # -> Item, Item1
Z = UnitZ(Factor=1)
angle = Angle(VectorA=item.Item, VectorB=item.Item1, Plane=scale.Geometry)  # -> Angle, Reflex
cp = ControlPoints(Curve=scale.Geometry)  # -> Points, Weights, Knots
line = LineSDL(Start=area_3.Centroid, Direction=Z, Length=Slider(2846, range=0..10000))
deg = Degrees(Radians=angle.Angle)
duppt = RemoveDuplicatePts(Points=cp.Points, Tolerance=0.01)
division = Division(A=deg, B="2")
end = EndPoints(Curve=line)  # -> Start, End
ln = Line(StartPoint=area_2.Centroid, EndPoint=duppt)
curvepoint = PointOnCurve(ln, parameter=0.961)

# ---- group: K
len = Length(Curve=ln)

# ----
scale_2 = Scale(Geometry=ln, Center=area_3.Centroid, Factor=Slider(0.3, range=0..1))  # -> Geometry, Transform
dist = Distance(PointA=area_2.Centroid, PointB=curvepoint)
Z_2 = UnitZ(Factor=angle_break)
panel = Panel(len)
eval = Evaluate(F="sqrt(x²-y²)", x=len, y=dist)
ln_2 = Line(StartPoint=curvepoint, EndPoint=area_2.Centroid)

# ---- group: x
len_2 = Length(Curve=ln_2)

# ----
eval_2 = Evaluate(F="sqrt(y²-x²)", x=len_2, y=height_of_deploy)
Z_3 = UnitZ(Factor=eval_2)
Z_4 = UnitZ(Factor=eval)
move = Move(Geometry=area_2.Centroid, Motion=Z_3)  # -> Geometry, Transform
move_2 = Move(Geometry=line, Motion=Z_4)  # -> Geometry, Transform
ln_3 = Line(StartPoint=move.Geometry, EndPoint=curvepoint)
end_2 = EndPoints(Curve=move_2.Geometry)  # -> Start, End

# ---- group: K
len_3 = Length(Curve=ln_3)

# ----
ln_4 = Line(StartPoint=end_2.Start, EndPoint=curvepoint)
pt = Point(end_2.Start)
move_3 = Move(Geometry=scale_2.Geometry, Motion=Z_4)  # -> Geometry, Transform
panel_2 = Panel(len_3)
rad = Radians(Degrees=division)
dist_2 = Distance(PointA=pt, PointB=move.Geometry)
rotate = Rotate(Geometry=move_3.Geometry, Angle=rad, Plane=move_2.Geometry)  # -> Geometry, Transform
Z_5 = UnitZ(Factor=1)
end_3 = EndPoints(Curve=rotate.Geometry)  # -> Start, End

eval_3 = EvaluateCurve(Curve=scale_2.Geometry, Parameter="0.5")  # -> Point, Tangent, Angle
rad_2 = Radians(Degrees="90")
rotate_2 = Rotate(Geometry=scale_2.Geometry, Angle=rad_2, Plane=eval_3.Point)  # -> Geometry, Transform
vec2pt = Vector2Pt(PointA=eval_3.Point, PointB=curvepoint, Unitize=False)  # -> Vector, Length
move_4 = Move(Geometry=rotate_2.Geometry, Motion=vec2pt.Vector)  # -> Geometry, Transform

extr = Extrude(Base=rotate.Geometry, Direction=Z_5)
pt_2 = Point(end_3.End)
pline = PolyLine(Vertices=pt_2, Closed=True)
fillet = FilletDistance(Curve=pline, Distance=material_thickness)
explode_2 = Explode(Curve=fillet, Recursive=True)  # -> Segments, Vertices
pline_2 = PolyLine(Vertices=explode_2.Vertices, Closed=False)
boundary = BoundarySurfaces(Edges=pline_2)
explode_3 = Explode(Curve=pline_2, Recursive=True)  # -> Segments, Vertices
md_slider = MDSlider(slider_value=Point(0.5, 0.5, 0.5), SliderMode=0, x_domain=Domain(0, 1), y_domain=Domain(0, 1), z_domain=Domain(0, 1))
item_2 = ListItem(List=move_4.Geometry, Index=0, Wrap=True)  # -> flatten(Item), flatten(Item1), flatten(Item2)
item_3 = ListItem(List=flatten(explode_3.Segments), Index=0, Wrap=True)  # -> Item, Item1, Item2, Item3, Item4, Item5
vec2pt_2 = Vector2Pt(PointA=pt, PointB=move.Geometry, Unitize=False)  # -> Vector, Length
pline_3 = PolyLine(Vertices=pt_2, Closed=True)
crv_2 = Curve(simplify(item_2.Item))
crv_3 = Curve(simplify(item_2.Item1))
crv_4 = Curve(simplify(item_2.Item2))
evalsrf = EvaluateSurface(Surface=boundary, Point=md_slider)  # -> Point, Normal, Frame
crv_5 = Curve(item_3.Item1)
crv_6 = Curve(item_3.Item3)
crv_7 = Curve(simplify(item_3.Item5))
fillet_2 = FilletDistance(Curve=pline_3, Distance=width)
loft = Loft(Curves=[crv_7, crv_2], Options={Adjust=False, Closed=False, LoftEnds=0, LoftSimp=0, LoftType=0, Rebuild=10, Refit=0.01})
loft_2 = Loft(Curves=[crv_4, crv_6], Options={Adjust=False, Closed=False, LoftEnds=0, LoftSimp=0, LoftType=0, Rebuild=10, Refit=0.01})
loft_3 = Loft(Curves=[crv_3, crv_5], Options={Adjust=False, Closed=False, LoftEnds=0, LoftSimp=0, LoftType=0, Rebuild=10, Refit=0.01})
offset = Offset(Curve=move_4.Geometry, Distance=material_thickness, Plane=PlaneXY(0, 0, 0), Corners=1)  # -> flatten(Curve)
amp = Amplitude(Vector=evalsrf.Normal, Amplitude=material_thickness)
explode_4 = Explode(Curve=fillet_2, Recursive=True)  # -> Segments, Vertices
item_4 = ListItem(List=flatten(offset), Index=0, Wrap=True)  # -> Item, Item1, Item2
md_slider_2 = MDSlider(slider_value=Point(0.5, 0.5, 0.5), SliderMode=0, x_domain=Domain(0, 1), y_domain=Domain(0, 1), z_domain=Domain(0, 1))
pline_4 = PolyLine(Vertices=explode_4.Vertices, Closed=False)
move_5 = Move(Geometry=pline_4, Motion=vec2pt_2.Vector)  # -> Geometry, Transform
area_4 = Area(Geometry=move_5.Geometry)  # -> Area, Centroid
vec2pt_3 = Vector2Pt(PointA=pt, PointB=area_4.Centroid, Unitize=False)  # -> Vector, Length
eval_4 = EvaluateCurve(Curve=reparameterize([item_3.Item, item_3.Item2, item_3.Item4]), Parameter="0.5")  # -> Point, Tangent, Angle
ln_5 = Line(StartPoint=eval_4.Point, EndPoint=pt)  # -> graft(Line)
flatten = FlattenTree(Tree=ln_5, Path="{0}")
Z_6 = UnitZ(Factor=material_thickness)
extr_2 = Extrude(Base=boundary, Direction=amp)
explode_5 = Explode(Curve=pline_4, Recursive=True)  # -> Segments, Vertices
move_6 = Move(Geometry=explode_5.Segments, Motion=vec2pt_2.Vector)  # -> Geometry, Transform
item_5 = ListItem(List=flatten(move_6.Geometry), Index=0, Wrap=True)  # -> Item, Item1, Item2, Item3, Item4, Item5
evalsrf_2 = EvaluateSurface(Surface=loft, Point=md_slider_2)  # -> Point, Normal, Frame
evalsrf_3 = EvaluateSurface(Surface=loft_2, Point=md_slider_2)  # -> Point, Normal, Frame
evalsrf_4 = EvaluateSurface(Surface=loft_3, Point=md_slider_2)  # -> Point, Normal, Frame
crv_8 = Curve(item_5.Item3)
loft_4 = Loft(
    Curves=[crv_8, item_4.Item2],
    Options={Adjust=False, Closed=False, LoftEnds=0, LoftSimp=0, LoftType=0, Rebuild=10, Refit=0.01})
crv_9 = Curve(item_5.Item1)
loft_5 = Loft(
    Curves=[item_4.Item1, crv_9],
    Options={Adjust=False, Closed=False, LoftEnds=0, LoftSimp=0, LoftType=0, Rebuild=10, Refit=0.01})
crv_10 = Curve(simplify(item_5.Item5))
loft_6 = Loft(
    Curves=[item_4.Item, crv_10],
    Options={Adjust=False, Closed=False, LoftEnds=0, LoftSimp=0, LoftType=0, Rebuild=10, Refit=0.01})
extr_3 = Extrude(Base=move_5.Geometry, Direction=Z_6)
md_slider_3 = MDSlider(slider_value=Point(0.5, 0.5, 0.5), SliderMode=0, x_domain=Domain(0, 1), y_domain=Domain(0, 1), z_domain=Domain(0, 1))
move_7 = Move(Geometry=ln_5, Motion=Z_2)  # -> Geometry, Transform
amp_2 = Amplitude(Vector=evalsrf_2.Normal, Amplitude=material_thickness)
amp_3 = Amplitude(Vector=evalsrf_3.Normal, Amplitude=material_thickness)
amp_4 = Amplitude(Vector=evalsrf_4.Normal, Amplitude=material_thickness)
multiplication = Multiplication(A=material_thickness, B=2)
cap = CapHoles(Brep=extr_3)
evalsrf_5 = EvaluateSurface(Surface=loft_5, Point=md_slider_3)  # -> Point, Normal, Frame
evalsrf_6 = EvaluateSurface(Surface=loft_4, Point=md_slider_3)  # -> Point, Normal, Frame
rev = Reverse(Vector=amp_3)
rev_2 = Reverse(Vector=amp_4)
scale_3 = Scale(Geometry=move_7.Geometry, Center=area_4.Centroid, Factor=thickness_of_middle_post)  # -> graft(Geometry), Transform
item_6 = ListItem(List=flatten, Index=0, Wrap=True)  # -> flatten(Item), flatten(Item1), flatten(Item2)
Z_7 = UnitZ(Factor=Slider(462, range=0..1000))
Z_8 = UnitZ(Factor=multiplication)
evalsrf_7 = EvaluateSurface(Surface=loft_6, Point=md_slider_3)  # -> Point, Normal, Frame
extr_4 = Extrude(Base=loft_3, Direction=rev_2)
amp_5 = Amplitude(Vector=evalsrf_5.Normal, Amplitude=material_thickness)
amp_6 = Amplitude(Vector=evalsrf_6.Normal, Amplitude=material_thickness)
extr_5 = Extrude(Base=loft, Direction=amp_2)
extr_6 = Extrude(Base=loft_2, Direction=rev)
move_8 = Move(Geometry=cap, Motion=Z_8)  # -> Geometry, Transform
flatten_2 = FlattenTree(Tree=scale_3.Geometry, Path="{0}")
dupln = RemoveDuplicateLines(Lines=flatten_2, Tolerance=0.01)
item_7 = ListItem(List=dupln, Index=0, Wrap=True)  # -> flatten(Item), flatten(Item1), flatten(Item2)
crv_11 = Curve(item_6.Item1)
crv_12 = Curve(item_6.Item2)
crv_13 = Curve(item_6.Item)
loft_7 = Loft(
    Curves=[scale_3.Geometry, ln_5],
    Options={Adjust=False, Closed=False, LoftEnds=0, LoftSimp=0, LoftType=0, Rebuild=10, Refit=0.01})
extr_7 = Extrude(Base=[crv_9, crv_8, crv_10], Direction=Z_7)
amp_7 = Amplitude(Vector=evalsrf_7.Normal, Amplitude=material_thickness)
rev_3 = Reverse(Vector=amp_5)
dupln_2 = RemoveDuplicateLines(Lines=flatten_2, Tolerance=0.01)
rev_4 = Reverse(Vector=amp_7)
loft_8 = Loft(
    Curves=[item_6.Item, item_7.Item],
    Options={Adjust=False, Closed=False, LoftEnds=0, LoftSimp=0, LoftType=0, Rebuild=10, Refit=0.01})
loft_9 = Loft(
    Curves=[item_6.Item1, item_7.Item1],
    Options={Adjust=False, Closed=False, LoftEnds=0, LoftSimp=0, LoftType=0, Rebuild=10, Refit=0.01})
loft_10 = Loft(
    Curves=[item_6.Item2, item_7.Item2],
    Options={Adjust=False, Closed=False, LoftEnds=0, LoftSimp=0, LoftType=0, Rebuild=10, Refit=0.01})
Z_9 = UnitZ(Factor=easel_tip)
subtraction = Subtraction(A=stand_support, B=angle_break)
item_8 = ListItem(List=dupln_2, Index=0, Wrap=True)  # -> Item, Item1, Item2
Z_10 = UnitZ(Factor=subtraction)
extr_8 = Extrude(Base=loft_5, Direction=rev_3)
extr_9 = Extrude(Base=loft_4, Direction=amp_6)
extr_10 = Extrude(Base=loft_6, Direction=rev_4)
end_4 = EndPoints(Curve=item_8.Item1)  # -> Start, End
extr_11 = Extrude(Base=item_8.Item, Direction=Z_9)
extr_12 = Extrude(Base=item_8.Item2, Direction=Z_10)
extr_13 = Extrude(Base=item_8.Item1, Direction=Z_9)
pdecon = Deconstruct(Point=end_4.End)  # -> XComponent, YComponent, ZComponent
Z_11 = UnitZ(Factor=material_thickness)
number_slider_2 = Slider(333, range=0..2000)
Z_12 = UnitZ(Factor=number_slider_2)
addition = Addition(A=amp, B=Z_12)
Z_13 = UnitZ(Factor=addition)
move_9 = Move(Geometry=area.Centroid, Motion=Z_13)  # -> Geometry, Transform
rectangle = Rectangle(Plane=move_9.Geometry, XSize=painting_stand_x, YSize=painting_stand_y, Radius=number_slider)  # -> Rectangle, Length
area_5 = Area(Geometry=rectangle.Rectangle)  # -> Area, Centroid
vec2pt_4 = Vector2Pt(PointA=area_5.Centroid, PointB=move_9.Geometry, Unitize=False)  # -> Vector, Length
rectangle_2 = Rectangle(Plane=move_9.Geometry, XSize=painting_stand_x_2, YSize=painting_stand_y_2, Radius=number_slider)  # -> Rectangle, Length
area_6 = Area(Geometry=rectangle_2.Rectangle)  # -> Area, Centroid
move_10 = Move(Geometry=rectangle.Rectangle, Motion=vec2pt_4.Vector)  # -> Geometry, Transform
vec2pt_5 = Vector2Pt(PointA=area_6.Centroid, PointB=move_9.Geometry, Unitize=False)  # -> Vector, Length
md_slider_4 = MDSlider(slider_value=Point(0.5, 0.5, 0.5), SliderMode=0, x_domain=Domain(0, 1), y_domain=Domain(0, 1), z_domain=Domain(0, 1))
extr_14 = Extrude(Base=move_10.Geometry, Direction=Z_11)
move_11 = Move(Geometry=rectangle_2.Rectangle, Motion=vec2pt_5.Vector)  # -> Geometry, Transform
cap_2 = CapHoles(Brep=extr_14)
Z_14 = UnitZ(Factor=material_thickness)
extr_15 = Extrude(Base=move_11.Geometry, Direction=Z_14)
cap_3 = CapHoles(Brep=extr_15)
division_2 = Division(A=material_thickness, B="2")
evalsrf_8 = EvaluateSurface(Surface=loft_8, Point=md_slider_4)  # -> Point, Normal, Frame

evalsrf_9 = EvaluateSurface(Surface=loft_9, Point=md_slider_4)  # -> Point, Normal, Frame
crv_14 = Curve(item_3.Item2)
amp_8 = Amplitude(Vector=evalsrf_9.Normal, Amplitude=material_thickness)
end_5 = EndPoints(Curve=crv_14)  # -> Start, End
rev_5 = Reverse(Vector=amp_8)
vec2pt_6 = Vector2Pt(PointA=end_5.End, PointB=end_5.Start, Unitize=False)  # -> Vector, Length
extr_16 = Extrude(Base=loft_9, Direction=rev_5)
amp_9 = Amplitude(Vector=vec2pt_6.Vector, Amplitude=division_2)
move_12 = Move(Geometry=extr_16, Motion=amp_9)  # -> Geometry, Transform

extr_17 = Extrude(Base=extr_13, Direction=rev_5)
move_13 = Move(Geometry=extr_17, Motion=amp_9)  # -> Geometry, Transform
evalsrf_10 = EvaluateSurface(Surface=loft_10, Point=md_slider_4)  # -> Point, Normal, Frame
addition_2 = Addition(A=pdecon.ZComponent, B=number_slider_2)
crv_15 = Curve(item_3.Item4)
crv_16 = Curve(item_3.Item)
Z_15 = UnitZ(Factor=addition_2)
amp_10 = Amplitude(Vector=evalsrf_10.Normal, Amplitude=material_thickness)
move_14 = Move(Geometry=cap_2, Motion=Z_15)  # -> Geometry, Transform
amp_11 = Amplitude(Vector=evalsrf_8.Normal, Amplitude=material_thickness)
end_6 = EndPoints(Curve=crv_16)  # -> Start, End
end_7 = EndPoints(Curve=crv_15)  # -> Start, End
rev_6 = Reverse(Vector=amp_10)
extr_18 = Extrude(Base=extr_12, Direction=rev_6)
rev_7 = Reverse(Vector=amp_11)
extr_19 = Extrude(Base=extr_11, Direction=rev_7)
Z_16 = UnitZ(Factor=Slider(83, range=0..200))
addition_3 = Addition(A=Z_15, B=Z_16)
evalsrf_11 = EvaluateSurface(Surface=extr_7, Point=md_slider_4)  # -> Point, Normal, Frame
vec2pt_7 = Vector2Pt(PointA=end_6.End, PointB=end_6.Start, Unitize=False)  # -> Vector, Length
extr_20 = Extrude(Base=loft_10, Direction=rev_6)
vec2pt_8 = Vector2Pt(PointA=end_7.End, PointB=end_7.Start, Unitize=False)  # -> Vector, Length
extr_21 = Extrude(Base=loft_8, Direction=rev_7)
move_15 = Move(Geometry=cap_3, Motion=addition_3)  # -> Geometry, Transform
amp_12 = Amplitude(Vector=evalsrf_11.Normal, Amplitude=material_thickness)
amp_13 = Amplitude(Vector=vec2pt_7.Vector, Amplitude=division_2)
move_16 = Move(Geometry=extr_19, Motion=amp_13)  # -> Geometry, Transform
rev_8 = Reverse(Vector=amp_12)
amp_14 = Amplitude(Vector=vec2pt_8.Vector, Amplitude=division_2)
move_17 = Move(Geometry=extr_18, Motion=amp_14)  # -> Geometry, Transform
move_18 = Move(Geometry=extr_21, Motion=amp_13)  # -> Geometry, Transform
extr_22 = Extrude(Base=extr_7, Direction=rev_8)
move_19 = Move(Geometry=extr_20, Motion=amp_14)  # -> Geometry, Transform
merge = Merge(
    Data1=move_18.Geometry,
    Data2=move_12.Geometry,
    Data3=move_19.Geometry,
    Data4=extr_22,
    Data5=move_14.Geometry,
    Data6=move_15.Geometry,
    Data7=move_16.Geometry,
    Data8=extr_8,
    Data9=extr_9,
    Data10=extr_10,
    Data11=extr_5,
    Data12=extr_6,
    Data13=extr_4,
    Data14=move_17.Geometry,
    Data15=move_13.Geometry,
    Data16=cap,
    Data17=move_8.Geometry,
    Data18=extr_2)

# ---- group: BASIC DEFINITION
number_slider_3 = Slider(455, range=0..1000)  # disabled
crv_17 = Curve(<curve referenced from the Rhino model>)  # disabled
number_slider_4 = Slider(791, range=0..10000)  # disabled
area_7 = Area(Geometry=crv_17)  # -> Area, Centroid; disabled
explode_6 = Explode(Curve=crv_17, Recursive=True)  # -> Segments, Vertices; disabled
area_8 = Area(Geometry=crv_17)  # -> Area, Centroid; disabled
Z_17 = UnitZ(Factor=1)  # disabled
cp_2 = ControlPoints(Curve=crv_17)  # -> Points, Weights, Knots; disabled
line_2 = LineSDL(Start=area_8.Centroid, Direction=Z_17, Length=number_slider_4)  # disabled
duppt_2 = RemoveDuplicatePts(Points=cp_2.Points, Tolerance=0.01)  # disabled
end_8 = EndPoints(Curve=line_2)  # -> Start, End; disabled
ln_6 = Line(StartPoint=area_7.Centroid, EndPoint=duppt_2)  # disabled
curvepoint_2 = PointOnCurve(ln_6, parameter=0.895)  # disabled
dist_3 = Distance(PointA=area_7.Centroid, PointB=curvepoint_2)  # disabled
ln_7 = Line(StartPoint=curvepoint_2, EndPoint=area_7.Centroid)  # disabled

# ---- group: BASIC DEFINITION / K
len_4 = Length(Curve=ln_6)  # disabled

# ---- group: BASIC DEFINITION / x
len_5 = Length(Curve=ln_7)  # disabled

# ---- group: BASIC DEFINITION (continued)
panel_3 = Panel(len_4)  # disabled
eval_5 = Evaluate(F="sqrt(x²-y²)", x=len_4, y=dist_3)  # disabled
eval_6 = Evaluate(F="sqrt(y²-x²)", x=len_5, y=number_slider_3)  # disabled
Z_18 = UnitZ(Factor=eval_6)  # disabled
Z_19 = UnitZ(Factor=eval_5)  # disabled
move_20 = Move(Geometry=area_7.Centroid, Motion=Z_18)  # -> Geometry, Transform; disabled
move_21 = Move(Geometry=line_2, Motion=Z_19)  # -> Geometry, Transform; disabled
ln_8 = Line(StartPoint=move_20.Geometry, EndPoint=curvepoint_2)  # disabled
end_9 = EndPoints(Curve=move_21.Geometry)  # -> Start, End; disabled
ln_9 = Line(StartPoint=end_9.Start, EndPoint=curvepoint_2)  # disabled
pt_3 = Point(end_9.Start)  # disabled
dist_4 = Distance(PointA=pt_3, PointB=move_20.Geometry)  # disabled

# ---- group: BASIC DEFINITION / K
len_6 = Length(Curve=ln_8)  # disabled

# ---- group: BASIC DEFINITION (continued)
panel_4 = Panel(len_6)  # disabled
